# Grasshopper definition PaintAngles.gh (Grasshopper 1.0.8)
# plug-ins: RhinoCodePluginGH

# ---- group: Point Grid
number_slider = Slider(16, range=0..20)
number_slider_2 = Slider(16, range=0..20)
pt = ConstructPoint(XCoordinate=0, YCoordinate=0, ZCoordinate=0)
C = Cell({Plane=PlaneXY(2.5, 2.5, 0), Size=Domain2(u=-2.5..2.5, v=-2.5..2.5)})
arrrec = RectangularArray(Geometry=pt, Cell=C, XCount=number_slider, YCount=number_slider_2)  # -> Geometry, Transform
preview = CustomPreview(Geometry=arrrec.Geometry, Material=ColourSwatch(SwatchColor=RGB(136, 0, 255)))
del = DelaunayMesh(Points=arrrec.Geometry, Plane=PlaneXY(0, 0, 0))

# ---- group: Panels
crv = Curve([<curve referenced from the Rhino model> x3])
boundary = BoundarySurfaces(Edges=crv)
arrrec_2 = RectangularArray(Geometry=boundary, Cell=C, XCount=number_slider, YCount=number_slider_2)  # -> Geometry, Transform

# ----
fieldbrush_v1 = CSharpScript(points=arrrec.Geometry, surface=del)  # -> values; inputs points: list of Point3d, surface: Mesh
# ---------- fieldbrush_v1: C# ----------
#r "nuget: EasingFunctions, 1.0.1"
using System;
using System.IO;
using System.Linq;
using System.Collections;
using System.Collections.Generic;
using System.Drawing;

using SD = System.Drawing;
using SWF = System.Windows.Forms;
using EF = Eto.Forms;

using Rhino;
using Rhino.Input;
using Rhino.Input.Custom;
using Rhino.DocObjects;
using Rhino.Geometry;

using Grasshopper;
using Grasshopper.Kernel;
using Grasshopper.Kernel.Data;
using Grasshopper.Kernel.Parameters;
using Grasshopper.Kernel.Types;

public class Script_Instance : GH_ScriptInstance
{
    Brush _brush = new Brush();

    private void RunScript(List<Point3d> points, Mesh surface, ref object values)
    {
        values = _brush.GetValues(points, surface, this.Component.Params.Output[0]);
    }

    public override void AppendAdditionalMenuItems(SWF.ToolStripDropDown menu)
    {
        menu.Items.Add("Paint Output", default, (s, e) => _brush.DoPaint());
        menu.Items.Add("Reset Paint Cache", default, (s, e) => {
            _brush.Reset();
            this.Component.ExpireSolution(true);
        });
        menu.Items.Add(new SWF.ToolStripSeparator());
    }
}

class Brush : GetPoint
{ 
    // brush option indices
    readonly int sizeIndex;
    readonly int fosizeIndex;
    readonly int strengthIndex;
    
    // default values for brush options
    double _size = 12.0d;
    double _falloff = 24.0d;
    double _strength = 0.5d;

    // brush effect range
    double _maxValue = 60.0d;
    double _minValue = 1.0d;
    
    bool _mouseDown = false;
    Easing.Ease _ease;

    readonly double[] _cache = new double[1024];

    List<Point3d> _points;
    Mesh _pointSurface;
    IGH_Param _output;

    static readonly int s_refreshRate = 3;
    int _changeCounter = s_refreshRate;

    public Brush()
    {
        this.SetCommandPrompt("Paint");

        _ease = new Easing.Quartic(new Easing.Vector(Convert.ToSingle(_falloff - _size), Convert.ToSingle(_strength)));

        var optsizedouble = new OptionDouble(_size, 1, 256);
        var optfalloffdouble = new OptionDouble(_falloff, 1, 256);
        var optstrengthdouble = new OptionDouble(_strength, 0.1, 16);
        sizeIndex = this.AddOptionDouble("BrushSize", ref optsizedouble, "Enter Brush Size");
        fosizeIndex = this.AddOptionDouble("FalloffSize", ref optfalloffdouble, "Enter Falloff Size");
        strengthIndex = this.AddOptionDouble("Strength", ref optstrengthdouble, "Enter Brush Strength");

        FullFrameRedrawDuringGet = true;
    }

    public void Reset()
    {
        for (int i = 0; i < _cache.Length; i++)
        {
            _cache[i] = 0.0d;
        }
        _output.ExpireSolution(true);
    }
    
    public IEnumerable<double> GetValues(List<Point3d> points, Mesh surface, IGH_Param output) 
    {
        _points = points;
        _pointSurface = surface;
        _output = output;
        return _cache.Take(points.Count);
    }

    public void DoPaint()
    {
        GetResult res;
        do 
        {
            res = this.Get(onMouseUp: true);
            switch (res)
            {
                case GetResult.Option:
                	// one of brush options was changed
                    var opt = this.Option();
                    if (opt.Index == sizeIndex)
                    {
                        _size = opt.CurrentNumericValue;
                    }
                    else if (opt.Index == fosizeIndex)
                    {
                        _falloff = opt.CurrentNumericValue;
                    }
                    else if (opt.Index == strengthIndex)
                    {
                        _strength = opt.CurrentNumericValue;
                    }
                    _ease = new Easing.Quartic(new Easing.Vector(Convert.ToSingle(_falloff - _size), Convert.ToSingle(_strength)));
                    break;

                case GetResult.Point:
                    // use click in viewport; lets continue the loop
                    break;
            }
        } while (res != GetResult.Cancel); // user hit ESC key
    }

    protected override void OnMouseMove(GetPointMouseEventArgs e)
    {
        _mouseDown = e.LeftButtonDown;
    }

    protected override void OnDynamicDraw(GetPointDrawEventArgs e)
    {
        if (e.Viewport is null)
        {
            return;
        }

        Point3d p = e.CurrentPoint;
        Point2d cp = e.Viewport.WorldToClient(p);
        if (e.Viewport.GetFrustumLine(cp.X, cp.Y, out Line line))
        {
            line.Flip();
            Ray3d ray = new Ray3d(line.PointAt(0), line.Direction);

            double t = Rhino.Geometry.Intersect.Intersection.MeshRay(_pointSurface, ray);          
            if (t < 0) return;
            
            Point3d hitPoint = ray.PointAt(t);
            MeshPoint mp = _pointSurface.ClosestMeshPoint(hitPoint, double.MaxValue);
            Vector3d norm = _pointSurface.NormalAt(mp);
            Plane headPlane = new Plane(hitPoint, norm);
            Circle head = new Circle(headPlane, hitPoint, _size);
            Circle falloff = new Circle(headPlane, hitPoint, _falloff);

            e.Display.DrawCircle(head, SD.Color.Blue, 3);
            if (_falloff != _size)
            {
                e.Display.DrawCircle(falloff, SD.Color.LightGray, 2);
            }

            if (_mouseDown)
            {
                bool reverse = EF.Keyboard.Modifiers.HasFlag(EF.Keys.Shift);
                ApplyBrush(e.RhinoDoc, p, reverse);
            }
        }
    }

    void ApplyBrush(RhinoDoc doc, Point3d at, bool reverse)
    {
        bool changed = false;
        int index = 0;
        foreach (Point3d pp in _points)
        {
            double dist = at.DistanceTo(pp);
            if (dist < _falloff)
            {
                double value = GetValue(index);
                value = ComputeValue(dist, value, reverse);
                SetValue(index, value);
                changed |= true;
            }
            index++;
        }

        if (changed && _changeCounter == 0)
        {
            foreach (var dest in _output.Recipients)
            {
                dest.ExpireSolution(true);
            }
            _changeCounter = s_refreshRate;
        }
        else
            _changeCounter--;
    }

    double ComputeValue(double dist, double start, bool reverse)
    {
        double value = start;
        double incr = dist < _size ? _strength : _ease.Out(Convert.ToSingle(_falloff - dist));
        value += reverse ? -incr : incr;
        value = value > _maxValue ? _maxValue : value;
        value = value < _minValue ? _minValue : value;

        return value;
    }

    double GetValue(int index)
    {
        if (index < _cache.Length)
        {
            return _cache[index];
        }
        return 0.0d;
    }

    void SetValue(int index, double value)
    {
        var path = _output.VolatileData.Paths[0];
        var branch = _output.VolatileData.get_Branch(path);

        if (index >= 0 && index < branch.Count)
        {
            _cache[index] = value;
            branch[index] = new GH_Number(value);
        }
    }
}
# ---------- end fieldbrush_v1 ----------
num = Number(fieldbrush_v1)
panel = Panel(num)

# ---- group: Transformed Panels
X = UnitX(Factor=1)
gradient = Gradient(LowerLimit=1, UpperLimit=60, Parameter=num, stops=[0: RGB(255, 212, 59), 0.5: RGB(217, 72, 15), 1: RGB(166, 30, 77)])
rad = Radians(Degrees=num)
move = Move(Geometry=X, Motion=arrrec.Geometry)  # -> Geometry, Transform
line = LineSDL(Start=move.Geometry, Direction=X, Length=1)
rotax = RotateAxis(Geometry=arrrec_2.Geometry, Angle=rad, Axis=line)  # -> Geometry, Transform
preview_2 = CustomPreview(Geometry=rotax.Geometry, Material=gradient)
