# Grasshopper definition PaintPanels_Lib.gh (Grasshopper 1.0.8)
# plug-ins: RhinoCodePluginGH

# ---- group: Point Grid
number_slider = Slider(16, range=0..20)
number_slider_2 = Slider(16, range=0..20)
pt = ConstructPoint(XCoordinate=0, YCoordinate=0, ZCoordinate=0)
C = Cell({Plane=PlaneXY(2.5, 2.5, 0), Size=Domain2(u=-2.5..2.5, v=-2.5..2.5)})
arrrec = RectangularArray(Geometry=pt, Cell=C, XCount=number_slider, YCount=number_slider_2)  # -> Geometry, Transform
del = DelaunayMesh(Points=arrrec.Geometry, Plane=PlaneXY(0, 0, 0))
preview = CustomPreview(Geometry=arrrec.Geometry, Material=ColourSwatch(SwatchColor=RGB(136, 0, 255)))

# ---- group: Panels
crv = Curve([<curve referenced from the Rhino model> x3])
boundary = BoundarySurfaces(Edges=crv)
arrrec_2 = RectangularArray(Geometry=boundary, Cell=C, XCount=number_slider, YCount=number_slider_2)  # -> Geometry, Transform

# ----
fieldbrush_v2 = CSharpScript(library="BrushTools", points=arrrec.Geometry, surface=del)  # -> values; inputs library: tree, points: list of Point3d, surface: Mesh
#   port library: Library or libraries to execute script with
# ---------- fieldbrush_v2: C# ----------
using System;
using System.IO;
using System.Linq;
using System.Collections;
using System.Collections.Generic;
using System.Drawing;

using SD = System.Drawing;
using SWF = System.Windows.Forms;
using EF = Eto.Forms;

using Rhino;
using Rhino.Input;
using Rhino.Input.Custom;
using Rhino.DocObjects;
using Rhino.Geometry;

using Grasshopper;
using Grasshopper.Kernel;
using Grasshopper.Kernel.Data;
using Grasshopper.Kernel.Parameters;
using Grasshopper.Kernel.Types;

public class Script_Instance : GH_ScriptInstance
{
    const string BRUSH_ICON = "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";
    
    Brush _brush = new Brush();

    private void RunScript(List<Point3d> points, Mesh surface, ref object values)
    {
        values = _brush.GetValues(points, surface, this.Component.Params.Output[0]);
    }

    public override void AppendAdditionalMenuItems(SWF.ToolStripDropDown menu)
    {
        using var ms = new MemoryStream(Convert.FromBase64String(BRUSH_ICON));
        Bitmap brushIcon = new Bitmap(ms);

        menu.Items.Add("Paint Output", brushIcon, (s, e) => _brush.DoPaint());
        menu.Items.Add("Reset Paint Cache", default, (s, e) => {
            _brush.Reset();
            this.Component.ExpireSolution(true);
        });
        menu.Items.Add(new SWF.ToolStripSeparator());
    }
}

class Brush : BrushTools.BaseBrush
{ 
    readonly double[] _cache = new double[1024];

    List<Point3d> _points;
    Mesh _pointSurface;    
    IGH_Param _output;

    static readonly int s_refreshRate = 3;
    int _changeCounter = s_refreshRate;

    public Brush() : base(12.0d, 24.0d, 0.5d)
    {
        FullFrameRedrawDuringGet = true;
    }

    public IEnumerable<double> GetValues(List<Point3d> points, Mesh surface, IGH_Param output) 
    {
        _points = points;
        _pointSurface = surface;
        _output = output;

        return _cache.Take(points.Count);
    }

    public void Reset()
    {
        for (int i = 0; i < _cache.Length; i++)
        {
            _cache[i] = 0.0d;
        }
        _output.ExpireSolution(true);
    }

    protected override IEnumerable<Mesh> GetPaintSurfaces() 
    {
        yield return _pointSurface;
    }

    protected override void ApplyBrush(RhinoDoc doc, Point3d at, bool reverse)
    {
        int index = 0;
        bool changed = false;
        foreach (Point3d pp in _points)
        {
            double dist = at.DistanceTo(pp);
            if (dist < m_falloff)
            {
                double value = GetValue(index);
                value = ComputeValue(dist, value, reverse);
                SetValue(index, value);
                changed |= true;
            }
            index++;
        }

        if (changed && _changeCounter == 0)
        {
            _changeCounter = s_refreshRate;
            foreach (var dest in _output.Recipients)
            {
                dest.ExpireSolution(true);
            }
        }
        else
        {
            _changeCounter--;
        }
    }

    double GetValue(int index)
    {
        if (index < _cache.Length)
        {
            return _cache[index];
        }
        return 0.0d;
    }

    void SetValue(int index, double value)
    {
        var path = _output.VolatileData.Paths[0];
        var branch = _output.VolatileData.get_Branch(path);

        if (index >= 0 && index < branch.Count)
        {
            _cache[index] = value;
            branch[index] = new GH_Number(value);
        }
    }
}
# ---------- end fieldbrush_v2 ----------
fieldbrush_v1 = CSharpScript(points=arrrec.Geometry, surface=del)  # -> values; inputs points: list of Point3d, surface: Mesh; disabled
# ---------- fieldbrush_v1: C# ----------
#r "nuget: EasingFunctions, 1.0.1"
using System;
using System.IO;
using System.Linq;
using System.Collections;
using System.Collections.Generic;
using System.Drawing;

using SD = System.Drawing;
using SWF = System.Windows.Forms;
using EF = Eto.Forms;

using Rhino;
using Rhino.Input;
using Rhino.Input.Custom;
using Rhino.DocObjects;
using Rhino.Geometry;

using Grasshopper;
using Grasshopper.Kernel;
using Grasshopper.Kernel.Data;
using Grasshopper.Kernel.Parameters;
using Grasshopper.Kernel.Types;

public class Script_Instance : GH_ScriptInstance
{
    Brush _brush = new Brush();

    private void RunScript(List<Point3d> points, Mesh surface, ref object values)
    {
        values = _brush.GetValues(points, surface, this.Component.Params.Output[0]);
    }

    public override void AppendAdditionalMenuItems(SWF.ToolStripDropDown menu)
    {
        menu.Items.Add("Paint Output", default, (s, e) => _brush.DoPaint());
        menu.Items.Add("Reset Paint Cache", default, (s, e) => {
            _brush.Reset();
            this.Component.ExpireSolution(true);
        });
        menu.Items.Add(new SWF.ToolStripSeparator());
    }
}

class Brush : GetPoint
{ 
    readonly int sizeIndex;
    readonly int fosizeIndex;
    readonly int strengthIndex;

    double _size = 8f;
    double _falloff = 16f;
    double _strength = 0.1f;
    double _maxValue = 60f;
    double _minValue = 1f;
    bool _mouseDown = false;
    Easing.Ease _ease;

    readonly double[] _cache = new double[1024];

    List<Point3d> _points;
    Mesh _pointSurface;    
    IGH_Param _output;

    static readonly int s_refreshRate = 3;
    int _changeCounter = s_refreshRate;

    public Brush()
    {
        this.SetCommandPrompt("Paint");

        var optsizedouble = new OptionDouble(_size, 1, 100);
        var optfalloffdouble = new OptionDouble(_falloff, 1, 100);
        var optstrengthdouble = new OptionDouble(_strength, 1, 10);
        sizeIndex = this.AddOptionDouble("BrushSize", ref optsizedouble, "Enter Brush Size");
        fosizeIndex = this.AddOptionDouble("FalloffSize", ref optfalloffdouble, "Enter Falloff Size");
        strengthIndex = this.AddOptionDouble("Strength", ref optstrengthdouble, "Enter Brush Strength");

        FullFrameRedrawDuringGet = true;
    }

    public void Reset()
    {
        for (int i = 0; i < _cache.Length; i++)
        {
            _cache[i] = 0.0d;
        }
        _output.ExpireSolution(true);
    }
    
    public IEnumerable<double> GetValues(List<Point3d> points, Mesh surface, IGH_Param output) 
    {
        _points = points;
        _pointSurface = surface;
        _output = output;
        return _cache.Take(points.Count);
    }

    public void DoPaint()
    {
        GetResult res;
        do 
        {
            res = this.Get(onMouseUp: true);
            switch (res)
            {
                case GetResult.Option:
                    var opt = this.Option();
                    if (opt.Index == sizeIndex)
                        _size = opt.CurrentNumericValue;
                    else
                    if (opt.Index == fosizeIndex)
                        _falloff = opt.CurrentNumericValue;
                    else
                    if (opt.Index == strengthIndex)
                        _strength = opt.CurrentNumericValue;
                    break;

                case GetResult.Point:
                    // do the things
                    break;
            }
        } while (res != GetResult.Cancel);
    }

    protected override void OnMouseMove(GetPointMouseEventArgs e)
    {
        _mouseDown = e.LeftButtonDown;
    }

    protected override void OnDynamicDraw(GetPointDrawEventArgs e)
    {
        if (e.Viewport is null)
        {
            return;
        }

        Point3d p = e.CurrentPoint;
        Point2d cp = e.Viewport.WorldToClient(p);
        if (e.Viewport.GetFrustumLine(cp.X, cp.Y, out Line line))
        {
            line.Flip();
            Ray3d ray = new Ray3d(line.PointAt(0), line.Direction);

            double t = Rhino.Geometry.Intersect.Intersection.MeshRay(_pointSurface, ray);          
            if (t < 0) return;
            
            Point3d hitPoint = ray.PointAt(t);
            MeshPoint mp = _pointSurface.ClosestMeshPoint(hitPoint, double.MaxValue);
            Vector3d norm = _pointSurface.NormalAt(mp);
            Plane headPlane = new Plane(hitPoint, norm);
            Circle head = new Circle(headPlane, hitPoint, _size);
            Circle falloff = new Circle(headPlane, hitPoint, _falloff);

            e.Display.DrawCircle(head, SD.Color.Blue, 3);
            if (_falloff != _size)
            {
                e.Display.DrawCircle(falloff, SD.Color.LightGray, 2);
            }

            bool changed = false;
            if (_mouseDown)
            {
                bool reverse = EF.Keyboard.Modifiers.HasFlag(EF.Keys.Shift);

                int index = 0;
                foreach (Point3d pp in _points)
                {
                    double dist = p.DistanceTo(pp);
                    if (dist < _falloff)
                    {
                        double value = GetValue(index);
                        double incr = _strength * dist < _size ? 1.0d : _ease.Out(Convert.ToSingle(dist));
                        value += reverse ? -incr : incr;
                        value = value > _maxValue ? _maxValue : value;
                        value = value < _minValue ? _minValue : value;

                        SetValue(index, value);
                        changed |= true;
                    }
                    index++;
                }

                if (changed && _changeCounter == 0)
                {
                    foreach (var dest in _output.Recipients)
                    {
                        dest.ExpireSolution(true);
                    }
                    _changeCounter = s_refreshRate;
                }
                else
                 _changeCounter--;
            }
        }
    }

    double GetValue(int index)
    {
        if (index < _cache.Length)
        {
            return _cache[index];
        }
        return 0.0d;
    }

    void SetValue(int index, double value)
    {
        var path = _output.VolatileData.Paths[0];
        var branch = _output.VolatileData.get_Branch(path);

        if (index >= 0 && index < branch.Count)
        {
            _cache[index] = value;
            branch[index] = new GH_Number(value);
        }
    }
}
# ---------- end fieldbrush_v1 ----------
num = Number(fieldbrush_v2)
panel = Panel(num)

# ---- group: Transformed Panels
X = UnitX(Factor=1)
gradient = Gradient(LowerLimit=1, UpperLimit=60, Parameter=num, stops=[0: RGB(255, 212, 59), 0.5: RGB(217, 72, 15), 1: RGB(166, 30, 77)])
rad = Radians(Degrees=num)
move = Move(Geometry=X, Motion=arrrec.Geometry)  # -> Geometry, Transform
line = LineSDL(Start=move.Geometry, Direction=X, Length=1)
rotax = RotateAxis(Geometry=arrrec_2.Geometry, Angle=rad, Axis=line)  # -> Geometry, Transform
preview_2 = CustomPreview(Geometry=rotax.Geometry, Material=gradient)
